vi "CLT.gvi"   [LabVIEW NXG]
panel controls:
  "intervals_3": i32 = 10
  "stop": bool
  "milliseconds to wait": u32
panel indicators:
  "Graph_3": T1
types:
  T1 = cluster{"X Values": f64[], "Histogram: h(x)": i32[]}
diagram:
  s1 = f64[] []  # shift register
  while (iteration -> i1) {
    Wait Ms(msToWait=$"milliseconds to wait")
    for (N = 1000) {
      for (N = 1000) {
        Random Number() -> (number (0 to 1)=w3)
        append w3 to w2
      }
      append w2 to w1
    }
    Add Array Elements(numeric array=w1) -> (sum=w4)
    Divide(x=w4, y=1000000) -> w5
    Subtract(x=w5, y=0.5) -> w6
    Divide(x=w6, y=0.28867513459) -> w7
    Insert Into Array(inArray=s1, index0=i1, new=w7) -> w8
    call "Histogram.gvi"(X=w8, intervals=$intervals_3) -> (Histogram Graph=w9)
    $Graph_3 <- w9
    next s1 = w8
    stop if $stop
  }
