vi "CLT_forloop.gvi"   [LabVIEW NXG]
panel controls:
  "intervals_2": i32 = 10
panel indicators:
  "Graph_2": T1
types:
  T1 = cluster{"X Values": f64[], "Histogram: h(x)": i32[]}
diagram:
  s1 = f64[] []  # shift register
  for (N = 1000) (iteration -> i1) {
    for (N = 1000) {
      for (N = 1000) {
        Random Number() -> (number (0 to 1)=w3)
        append w3 to w2
      }
      append w2 to w1
    }
    Add Array Elements(numeric array=w1) -> (sum=w4)
    Divide(x=w4, y=1000000) -> w5
    Insert Into Array(inArray=s1, index0=i1, new=w5) -> w6
    call "Histogram.gvi"(X=w6, intervals=$intervals_2) -> (Histogram Graph=w7)
    $Graph_2 <- w7
    next s1 = w6
  }
