vi "DataTypes.gvi"   [LabVIEW NXG]
panel controls:
  "String": string
panel indicators:
  "Output byte array": u8[]
  "element": u8
  "0, 1": i16[]
  "element_2": u8
  "0, 1_2": i16[]
  "element_3": u8
  "0, 1_3": i16[]
diagram:
  call "String to Byte Array.gvi"(Input String=$String) -> (Output byte array=w1)
  Array Index(array=w1) -> (out0[0]=w2, out1[1]=w3, out2[2]=w4)
  $element <- w2
  Number To Boolean Array(number=w2) -> (Boolean array=w5)
  Boolean To Integer(Boolean=w5) -> (0, 1=w6)
  $"0, 1" <- w6
  $"Output byte array" <- w1
  $element_2 <- w3
  Number To Boolean Array(number=w3) -> (Boolean array=w7)
  Boolean To Integer(Boolean=w7) -> (0, 1=w8)
  $"0, 1_2" <- w8
  Number To Boolean Array(number=w4) -> (Boolean array=w9)
  Boolean To Integer(Boolean=w9) -> (0, 1=w10)
  $"0, 1_3" <- w10
  $element_3 <- w4
