vi "Histogram.gvi"   [LabVIEW NXG]
inputs:
  "X": f64[]
  "intervals": i32 = 10
outputs:
  "Histogram Graph": T1
  "Histogram: h(x)": i32[]
  "X Values": f64[]
  "error": i32
types:
  T1 = cluster{"X Values": f64[], "Histogram: h(x)": i32[]}
diagram:
  Native Method Call(UnnamedParameter1 in=0, X in=$X, intervals in=$intervals) -> (Histogram: h(x) out=w1, UnnamedParameter1 out=w2, X Values out=w3)
  $"Histogram: h(x)" <- w1
  $"X Values" <- w3
  Property Node(instance in=T1 {all zero or empty}, "X Values"=w3, "Histogram: h(x)"=w1) -> (instance out=w4)
  $"Histogram Graph" <- w4
  $error <- w2
