vi "SWF.gvi"   [LabVIEW NXG]
panel controls:
  "amplitude": f64 = 1
  "frequency": f64 = 10
  "sampling info": cluster{"Fs": f64, "#s": f64} = {"Fs"=1000, "#s"=1000}
  "frequency_2": f64 = 10
  "amplitude_2": f64 = 1
  "sampling info_2": cluster{"Fs": f64, "#s": f64} = {"Fs"=1000, "#s"=1000}
  "frequency_3": f64 = 10
  "amplitude_3": f64 = 1
  "sampling info_3": cluster{"Fs": f64, "#s": f64} = {"Fs"=1000, "#s"=1000}
  "filter type": T2 = "Lowpass"
  "order": i32 = 2
  "low cutoff freq: fl": f64 = 0.125
panel indicators:
  "power spectrum / psd": T1
  "PSD": T1
  "Y": f64[]
  "dt": f64
  "Filtered X": f64[]
  "Filtered": f64[]
  "SUM": waveform<f64>
  "Filtered PSD": T1
  "Filtered PSD_2": T1
types:
  T1 = cluster{"f0": f64, "df": f64, "magnitude": f64[]}
  T2 = enum{"Lowpass", "Highpass", "Bandpass", "Bandstop"}
diagram:
  call "Sine Waveform.gvi"(frequency=$frequency_3, amplitude=$amplitude_3, sampling info=$"sampling info_3") -> (signal out=w1, Error Out=w2)
  call "Sine Waveform.gvi"(frequency=$frequency, amplitude=$amplitude, sampling info=$"sampling info") -> (signal out=w3, Error Out=w4)
  call "Sine Waveform.gvi"(frequency=$frequency_2, amplitude=$amplitude_2, sampling info=$"sampling info_2") -> (signal out=w5, Error Out=w6)
  Waveform Add(w3, w5, error in=w4) -> w7
  Merge Errors(w6, w2) -> (error out=w8)
  Waveform Add(w7, w1, error in=w8) -> w9
  Property Node(instance in=w9) -> ("Y"=w10, "dt"=w11)
  Reciprocal(x=w11) -> w12
  call "Butterworth Filter (DBL).gvi"(filter type=$"filter type", X=w10, sampling freq: fs=w12, low cutoff freq: fl=$"low cutoff freq: fl", order=$order) -> (Filtered X=w13)
  $"Filtered X" <- w13
  $Y <- w10
  $dt <- w11
  $Filtered <- w13
  Build Waveform Node(Y=w13) -> (output waveform=w14)
  call "FFT Power Spectrum and PSD for 1 Chan2.gvi"(time signal=w14) -> (power spectrum / psd=w15)
  $"Filtered PSD" <- w15
  call "FFT Power Spectrum and PSD for 1 Chan2.gvi"(time signal=w9) -> (power spectrum / psd=w16)
  $"power spectrum / psd" <- w16
  $"Filtered PSD_2" <- w15
  $PSD <- w16
  $SUM <- w9
