vi "String to Byte Array.gvi"   [LabVIEW NXG]
inputs:
  "Input String": string
outputs:
  "Output byte array": u8[]
panel indicators:
  "String Length": i32
diagram:
  w1 = [["0", ""], ["1", ""], ["2", ""], ["3", ""], ["4", ""], ["5", ""], ["6", ""], ["7", ""], ["8", ""], ["9", "\t"], ["10", "\n"], ["11", ""], ["12", ""], ["13", "\r"], ["14", ""], ["15", ""], ["16", ""], ["17", ""], ["18", ""], ["19", ""], ["20", ""], ["21", ""], ["22", ""], ["23", ""], ["24", ""], ["25", ""], ["26", ""], ["27", ""], ["28", ""], ["29", ""], ["30", ""], ["31", ""], ["32", " "], ["33", "!"], ["34", "\""], ["35", "#"], ["36", "$"], ["37", "%"], ["38", "&"], ["39", "'"], ["40", "("], ["41", ")"], ["42", "*"], ["43", "+"], ["44", ","], ["45", "-"], ["46", "."], ["47", "/"], ["48", "0"], ["49", "1"], ["50", "2"], ["51", "3"], ["52", "4"], ["53", "5"], ["54", "6"], ["55", "7"], ["56", "8"], ["57", "9"], ["58", ":"], ["59", ";"]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]
  String Length(string=$"Input String") -> (length=w2)
  s1 = 0  # shift register
  for (N = w2) {
    Array Index(array=w1) -> (out0[_, 0]=w4)
    Array Index(array=w1) -> (out0[_, 1]=w5)
    String Subset(length (rest)=1, offset (0)=s1, string=$"Input String") -> w6
    Search 1D Array(1D array=w5, element=w6) -> (index of element=w7)
    Array Index(array=w4) -> (out0[w7]=w8)
    Scan From String(formatString="%d", inputString=w8) -> (out0=w9)
    To Unsigned Byte Integer(number=w9) -> w10
    Increment(x=s1) -> w11
    append w10 to w3
    next s1 = w11
  }
  $"Output byte array" <- w3
  $"String Length" <- w2
