vi "AM.gvi"   [LabVIEW NXG]
inputs:
  "frequency_M": f64 = 10
  "amplitude_M": f64 = 1
  "sampling info_M": cluster{"Fs": f64, "#s": f64} = {"Fs"=1000, "#s"=1000}
  "frequency_C": f64 = 10
  "amplitude_C": f64 = 1
  "sampling info_C": cluster{"Fs": f64, "#s": f64} = {"Fs"=1000, "#s"=1000}
outputs:
  "Carrier": waveform<f64>
  "AM": waveform<f64>
panel controls:
  "phase_M": f64
  "phase_C": f64
panel indicators:
  "Message_PSD": T1
  "Message": waveform<f64>
  "Carrier_PSD": T1
  "AM_PSD": T1
types:
  T1 = cluster{"f0": f64, "df": f64, "magnitude": f64[]}
diagram:
  call "Sine Waveform.gvi"(frequency=$frequency_M, amplitude=$amplitude_M, phase=$phase_M, sampling info=$"sampling info_M") -> (signal out=w1)
  call "FFT Power Spectrum and PSD for 1 Chan2.gvi"(time signal=w1) -> (power spectrum / psd=w2)
  $Message_PSD <- w2
  $Message <- w1
  call "Sine Waveform.gvi"(frequency=$frequency_C, amplitude=$amplitude_C, phase=$phase_C, sampling info=$"sampling info_C") -> (signal out=w3)
  $Carrier <- w3
  Waveform Add(w1, $amplitude_C) -> w4
  Waveform Divide(x=w3, y=$amplitude_C) -> w5
  Waveform Multiply(w4, w5) -> w6
  $AM <- w6
  call "FFT Power Spectrum and PSD for 1 Chan2.gvi"(time signal=w6) -> (power spectrum / psd=w7)
  $AM_PSD <- w7
  call "FFT Power Spectrum and PSD for 1 Chan2.gvi"(time signal=w3) -> (power spectrum / psd=w8)
  $Carrier_PSD <- w8
