vi "AMCoherent.gvi"   [LabVIEW NXG]
inputs:
  "AM": waveform<f64> = {dt=1, Y=[]}
  "Carrier": waveform<f64> = {dt=1, Y=[]}
  "low cutoff freq: fl": f64 = 0.125
  "order": i32 = 2
  "filter type": T1 = "Lowpass"
  "error in": error
outputs:
  "Demodulated Time": waveform<f64>
  "Demodulated PSD": T2
  "error out": error
types:
  T1 = enum{"Lowpass", "Highpass", "Bandpass", "Bandstop"}
  T2 = cluster{"f0": f64, "df": f64, "magnitude": f64[]}
diagram:
  Waveform Multiply($AM, $Carrier, error in=$"error in") -> (error out=w1, o=w2)
  Property Node(instance in=w2) -> ("dt"=w3)
  call "Butterworth Filter (DBL).gvi"(filter type=$"filter type", X=w2, sampling freq: fs=w3, low cutoff freq: fl=$"low cutoff freq: fl", order=$order) -> (Filtered X=w4)
  call "AC & DC Estimator.gvi"(Signal (V)=w4) -> (DC estimate (V)=w5)
  Subtract(x=w4, y=w5) -> w6
  Multiply(w6, [2]) -> w7
  Build Waveform Node(Y=w7) -> (output waveform=w8)
  $"Demodulated Time" <- w8
  call "FFT Power Spectrum and PSD for 1 Chan2.gvi"(time signal=w8) -> (power spectrum / psd=w9)
  $"Demodulated PSD" <- w9
  $"error out" <- w1
