vi "AMEnvolepeDetection_copied.gvi"   [LabVIEW NXG]
panel controls:
  "AM": waveform<f64> = {dt=1, Y=[]}
  "error in": error
  "order": i32 = 2
  "low cutoff freq: fl": f64 = 0.125
  "filter type": T2 = "Lowpass"
panel indicators:
  "error out": error
  "Demodulated Signal PSD": T1
  "Demodulated Signal Time Domain": waveform<f64>
types:
  T1 = cluster{"f0": f64, "df": f64, "magnitude": f64[]}
  T2 = enum{"Lowpass", "Highpass", "Bandpass", "Bandstop"}
diagram:
  Waveform Multiply($AM, Pi, error in=$"error in") -> (error out=w1, o=w2)
  Property Node(instance in=w2) -> ("Y"=w3)
  Array Size(array=w3) -> (size(s)=w4)
  for (N = w4) {
    w5 = each element of w3
    Is Greater Or Equal To 0(x=w5) -> w7
    Select(s=w7, t=w5, f=0) -> w8
    append w8 to w6
  }
  call "Butterworth Filter (DBL).gvi"(filter type=$"filter type", X=w6, low cutoff freq: fl=$"low cutoff freq: fl", order=$order) -> (Filtered X=w9)
  call "AC & DC Estimator.gvi"(Signal (V)=w9) -> (DC estimate (V)=w10)
  Subtract(x=w9, y=w10) -> w11
  Build Waveform Node(Y=w11) -> (output waveform=w12)
  $"Demodulated Signal Time Domain" <- w12
  call "FFT Power Spectrum and PSD for 1 Chan2.gvi"(time signal=w12) -> (power spectrum / psd=w13)
  $"Demodulated Signal PSD" <- w13
  $"error out" <- w1
