vi "AMTopLevelNew.gvi"   [LabVIEW NXG]
panel controls:
  "frequency_M": f64 = 10
  "amplitude_M": f64 = 1
  "sampling info_M": cluster{"Fs": f64, "#s": f64} = {"Fs"=1000, "#s"=1000}
  "frequency_C": f64 = 10
  "amplitude_C": f64 = 1
  "sampling info_C": cluster{"Fs": f64, "#s": f64} = {"Fs"=1000, "#s"=1000}
  "low cutoff freq: fl": f64 = 0.125
  "order": i32 = 2
  "filter type": T1 = "Lowpass"
panel indicators:
  "Coherent Demodulated Time": waveform<f64>
  "Coherent Demodulated PSD": T2
  "Message": waveform<f64>
  "AM": waveform<f64>
types:
  T1 = enum{"Lowpass", "Highpass", "Bandpass", "Bandstop"}
  T2 = cluster{"f0": f64, "df": f64, "magnitude": f64[]}
diagram:
  call "AM.gvi"(frequency_M=$frequency_M, amplitude_M=$amplitude_M, sampling info_M=$"sampling info_M", frequency_C=$frequency_C, amplitude_C=$amplitude_C, sampling info_C=$"sampling info_C") -> (Message=w1, Carrier=w2, AM=w3)
  $Message <- w1
  $AM <- w3
  call "AMCoherent.gvi"(AM=w3, Carrier=w2, low cutoff freq: fl=$"low cutoff freq: fl", order=$order, filter type=$"filter type") -> (Demodulated Time=w4, Demodulated PSD=w5)
  $"Coherent Demodulated Time" <- w4
  $"Coherent Demodulated PSD" <- w5
