vi "AMTopLevel_old.gvi"   [LabVIEW NXG]
panel controls:
  "frequency_M": f64 = 10
  "amplitude_M": f64 = 1
  "sampling info_M": cluster{"Fs": f64, "#s": f64} = {"Fs"=1000, "#s"=1000}
  "frequency_C": f64 = 10
  "amplitude_C": f64 = 1
  "sampling info_C": cluster{"Fs": f64, "#s": f64} = {"Fs"=1000, "#s"=1000}
  "low cutoff freq: fl Coherent": f64 = 0.125
  "order Coherent": i32 = 2
  "filter type Coherent": T1 = "Lowpass"
  "low cutoff freq: fl Envelope": f64 = 0.125
  "order Envelope": i32 = 2
  "filter type Envelope": T1 = "Lowpass"
panel indicators:
  "Coherent Demodulated Time Domain": waveform<f64>
  "Message": waveform<f64>
  "AM": waveform<f64>
  "Carrier": waveform<f64>
  "Coherent Demodulated PSD": T2
  "Envelope Demodulated Time": waveform<f64>
  "Envelope Demodulated PSD": T2
types:
  T1 = enum{"Lowpass", "Highpass", "Bandpass", "Bandstop"}
  T2 = cluster{"f0": f64, "df": f64, "magnitude": f64[]}
diagram:
  call "AM.gvi"(frequency_M=$frequency_M, amplitude_M=$amplitude_M, sampling info_M=$"sampling info_M", frequency_C=$frequency_C, amplitude_C=$amplitude_C, sampling info_C=$"sampling info_C") -> (Message=w1, Carrier=w2, AM=w3)
  $Message <- w1
  $Carrier <- w2
  call "AMCoherent_old.gvi"(AM=w3, Carrier=w2, low cutoff freq: fl=$"low cutoff freq: fl Coherent", filter type=$"filter type Coherent", order=$"order Coherent") -> (Demodulated Signal PSD=w4, Demodulated Signal Time Domain=w5)
  $"Coherent Demodulated PSD" <- w4
  $"Coherent Demodulated Time Domain" <- w5
  $AM <- w3
  call "AMEnvelopeDetection.gvi"(AM=w3, low cutoff freq: fl=$"low cutoff freq: fl Envelope", order=$"order Envelope", filter type=$"filter type Envelope") -> (Demodulated Time=w6, Demodulated PSD=w7)
  $"Envelope Demodulated Time" <- w6
  $"Envelope Demodulated PSD" <- w7
