vi "FM.gvi"   [LabVIEW NXG]
inputs:
  "msg. freq.": f64 = 1000
  "msg. amp.": f64 = 1
  "carrier freq.": f64 = 10000
  "carrier amp.": f64 = 1
  "sampling info": cluster{"Fs": f64, "#s": f64} = {"Fs"=200000, "#s"=1000}
  "delta f": f64 = 500
outputs:
  "fm signal": waveform<f64>
  "error out_2": error
  "PSD FM signal": T1
  "Message signal": waveform<f64>
panel indicators:
  "Error Out": error
types:
  T1 = cluster{"f0": f64, "df": f64, "magnitude": f64[]}
diagram:
  # sin(fm)
  call "Sine Waveform.gvi"(frequency=$"msg. freq.", amplitude=$"msg. amp.", phase=0, sampling info=$"sampling info") -> (signal out=w1, Error Out=w2)
  $"Message signal" <- w1
  # cos(fc)
  call "Sine Waveform.gvi"(frequency=$"carrier freq.", amplitude=$"carrier amp.", phase=90, sampling info=$"sampling info") -> (signal out=w3, Error Out=w4)
  # sin(fc)
  call "Sine Waveform.gvi"(frequency=$"carrier freq.", amplitude=$"carrier amp.", phase=0, sampling info=$"sampling info") -> (signal out=w5, Error Out=w6)
  Merge Errors(w4, w2, w6) -> (error out=w7)
  Property Node(instance in=w1) -> ("Y"=w8, "dt"=w9)
  call "Integral x(t).gvi"(x=w8, dt=w9) -> (integral x=w10, error=w11)
  call "Error Cluster From Error Code.gvi"(error code (0)=w11, error message ("")="Error in IIR", error in (no error)=w7) -> (Error Out=w12)
  Property Node(instance in=w3) -> ("Y"=w13)
  Multiply(PiTimes2, $"delta f") -> w14
  Multiply(w10, w14) -> w15
  # sin(theta m)
  Sine And Cosine(x=w15) -> (cos(x)=w16, sin(x)=w17)
  # cos(theta m)
  Multiply(w13, w16) -> w18
  Property Node(instance in=w5) -> ("Y"=w19)
  Multiply(w17, w19) -> w20
  Subtract(x=w18, y=w20) -> w21
  Build Waveform Node(Y=w21, dt=w9) -> (output waveform=w22)
  call "FFT Power Spectrum and PSD for 1 Chan2.gvi"(time signal=w22, error in=w12) -> (power spectrum / psd=w23, error out=w24)
  $"PSD FM signal" <- w23
  $"error out_2" <- w24
  $"fm signal" <- w22
  $"Error Out" <- w12
