vi "Power.gvi"   [LabVIEW NXG]
inputs:
  "waveform in": waveform<f64> = {dt=1, Y=[]}
  "integration time": f64
outputs:
  "signal power": f64
diagram:
  # Computes the power of a sinusoid in time
  Property Node(instance in=$"waveform in") -> ("dt"=w1, "Y"=w2)
  Square(x=w2) -> w3
  call "1D Numeric Integration.gvi"(Input Array=w3, dt=w1) -> (result=w4)
  Divide(x=w4, y=$"integration time") -> w5
  $"signal power" <- w5
