vi "AC & DC Estimator.gvi"   [LabVIEW NXG]
inputs:
  "Signal (V)": f64[]
outputs:
  "AC estimate (Vrms)": f64
  "DC estimate (V)": f64
diagram:
  Multiply(0.5, 0.5) -> w1
  Multiply(w1, 1.5) -> w2
  # AC Signal
  call "Hanning Window (DBL).gvi"(x=$"Signal (V)") -> (windowed x=w3)
  call "Mean (DBL).gvi"(X=w3) -> (mean=w4)
  Divide(x=w4, y=0.5) -> w5
  Subtract(x=$"Signal (V)", y=w5) -> w6
  call "Hanning Window (DBL).gvi"(x=w6) -> (windowed x=w7)
  call "Std Deviation and Variance.gvi"(X=w7, Weighting (Sample)="Population") -> (variance=w8)
  Divide(x=w8, y=w2) -> w9
  Square Root(x=w9) -> w10
  $"AC estimate (Vrms)" <- w10
  $"DC estimate (V)" <- w5
