vi "AM.gvi"   [LabVIEW NXG]
inputs:
  "frequency_M": f64 = 10
  "amplitude_M": f64 = 1
  "sampling info_M": cluster{"Fs": f64, "#s": f64} = {"Fs"=1000, "#s"=1000}
  "frequency_C": f64 = 10
  "amplitude_C": f64 = 1
  "sampling info_C": cluster{"Fs": f64, "#s": f64} = {"Fs"=1000, "#s"=1000}
outputs:
  "signal out_M": waveform<f64>
  "signal out_C": waveform<f64>
  "AM": waveform<f64>
  "PSD_AM": T1
  "PSD_M": T1
  "PSD_C": T1
panel controls:
  "phase_M": f64
  "phase_C": f64
types:
  T1 = cluster{"f0": f64, "df": f64, "magnitude": f64[]}
diagram:
  call "Sine Waveform.gvi"(frequency=$frequency_C, amplitude=$amplitude_C, phase=$phase_C, sampling info=$"sampling info_C") -> (signal out=w1)
  $"signal out_C" <- w1
  call "FFT Power Spectrum and PSD for 1 Chan2.gvi"(time signal=w1) -> (power spectrum / psd=w2)
  $PSD_C <- w2
  call "Sine Waveform.gvi"(frequency=$frequency_M, amplitude=$amplitude_M, phase=$phase_M, sampling info=$"sampling info_M") -> (signal out=w3)
  Waveform Multiply(w1, w3) -> w4
  Waveform Add(w1, w4) -> w5
  call "FFT Power Spectrum and PSD for 1 Chan2.gvi"(time signal=w5) -> (power spectrum / psd=w6)
  $PSD_AM <- w6
  $AM <- w4
  $"signal out_M" <- w3
  call "FFT Power Spectrum and PSD for 1 Chan2.gvi"(time signal=w3) -> (power spectrum / psd=w7)
  $PSD_M <- w7
