vi "Basic Multitone.gvi"   [LabVIEW NXG]
inputs:
  "start frequency": f64 = 10
  "seed": i32 = -1
  "delta frequency": f64 = 100
  "error in (no error)": error
  "#tones": i32 = 3
  "reset signal": bool
  "amplitude": f64 = -1
  "sampling info": cluster{"Fs": f64, "#s": f64} = {"Fs"=1000, "#s"=1000}
  "coerce frequencies?": bool
  "phase relationship": u16
outputs:
  "signal out": waveform<f64>
  "crest factor": f64
  "actual tone frequencies": f64[]
  "error out": error
diagram:
  case ($"error in (no error)") {
    frame No Error {
      s1 = f64[] []  # shift register
      for (N = $"#tones") (iteration -> i1) {
        Multiply($"delta frequency", i1) -> w6
        Add($"start frequency", w6) -> w7
        Build Array[ConcatenateInputs=True](s1, w7) -> w8
        append 1 to w5
        next s1 = w8
      }
      call "ma_Generate Multitone Phases.gvi"(#tones=$"#tones", seed=$seed, phase relationship=$"phase relationship") -> (Tone Phases=w9)
      call "Multitone generator.gvi"(tone frequencies=s1, tone amplitudes=w5, tone phases=w9, error in (no error)=$"error in (no error)", reset signal=$"reset signal", amplitude=$amplitude, sampling info=$"sampling info", coerce frequencies?=$"coerce frequencies?") -> (signal out=w3, crest factor=w2, actual tone frequencies=w4, error out=w1)
    }
    frame Error {
      To Time Stamp(number=0) -> w10
      Build Waveform Node(Y=f64[] [], dt=0, t0=w10) -> (output waveform=w3)
      w1 = $"error in (no error)"
      w2 = 0
      w4 = default
    }
  }
  $"signal out" <- w3
  $"crest factor" <- w2
  $"actual tone frequencies" <- w4
  $"error out" <- w1
