vi "Extract Single Tone Information from Hann Spectrum.gvi"   [LabVIEW NXG]
inputs:
  "complex spectrum in": c128[]
  "FFT size": i32
  "export mode": T1 = "detected signal"
  "sampling frequency": f64
  "error in": error
  "time signal in": f64[]
  "advanced search": T2 = {"approx freq. (optional)"=-1, "search (+/- % of Fsampl.)"=5}
outputs:
  "complex spectrum out": c128[]
  "detected frequency": f64
  "detected amplitude": f64
  "detected phase (deg)": f64
  "error out": error
  "time signal out": f64[]
  "measurement info": T3
types:
  T1 = enum{"none", "input signal", "detected signal", "residual signal"}
  T2 = cluster{"approx freq. (optional)": f64, "search (+/- % of Fsampl.)": f64}
  T3 = cluster{"uncertainty": f64, "Warning": bool, "comments": string}
  T4 = cluster{"Element 1": f64, "Element 2": bool, "Element 3": string}
diagram:
  case ($"error in") {
    frame No Error {
      sequence {
        frame 0 {
          Array Size(array=$"complex spectrum in") -> (size(s)=w8)
          Is Equal To 0(x=w8) -> w9
          # This frames calculates the Complex Spectrum of the provided Time Signal
          # if nothing is connected to the Complex Spectrum input.
          # Both Complex and Magnitude arrays are passed to the next frame
          case (w9) {
            frame False, Default {
              w10 = $"complex spectrum in"
              w11 = $"FFT size"
            }
            frame True {
              call "ma_FFT with Hanning.gvi"(time signal data=$"time signal in") -> (complex Hann spectrum=w10)
              Array Size(array=$"time signal in") -> (size(s)=w11)
            }
          }
          Complex To Polar(r * e^(i*theta)=w10) -> (r=w12)
          Replace Array Subset(inArray=w12, 0, 0) -> w13
          Replace Array Subset(inArray=w13, 1, 0) -> w14
        }
        frame 1 {
          # This frame performs the first iteration to find a good estimate for the tone Frequency and Amplitude
          sequence (after $"time signal in") (after w10) {
            frame 0 {
              Property Node(instance in=$"advanced search") -> ("approx freq. (optional)"=w15, "search (+/- % of Fsampl.)"=w16)
              Is Less Than 0(x=w15) -> w17
              Is Greater Than 0(x=$"sampling frequency") -> w18
              Select(s=w18, t=$"sampling frequency", f=w11) -> w19
              Divide(x=w19, y=w11) -> w20
              # This frame extracts the 3 dominant BINs either in the entire
              # spectrum or in the specified search region.
              case (w17) {
                frame False, Default {
                  Multiply(w11, 0.01) -> w23
                  Multiply(w16, w23) -> w24
                  To Long Integer(number=w24) -> w25
                  Max And Min(x=w25, y=1) -> (max(x,y)=w26: i32)
                  Add(w26, w26) -> w27
                  Increment(x=w27) -> w28
                  Divide(x=w15, y=w20) -> w29
                  To Long Integer(number=w29) -> w30
                  Subtract(x=w30, y=w26) -> w31
                  Max And Min(x=w31, y=1) -> (max(x,y)=w22: i32)
                  Array Subset(array=w14, index0=w22, length0=w28) -> w21
                }
                frame True {
                  w21 = w14
                  w22 = 0
                }
              }
              Array Max And Min(array=w21) -> (max index(es)=w32, max value=w33)
              Add(w32, w22) -> w34
              Increment(x=w32) -> w35
              Array Index(array=w21) -> (out0[w35]=w36)
              Decrement(x=w32) -> w37
              Array Index(array=w21) -> (out0[w37]=w38)
              Subtract(x=w36, y=w38) -> w39
              Sign(number=w39) -> (-1, 0, 1=w40)
              Increment(x=w40) -> w41
            }
            frame 1 {
              # Given the 3 dominant BINs, the exact
              # amplitude and frequency of the tone
              # can be calculated
              case (w41) {
                frame ..0 {
                  Divide(x=w33, y=w38) -> w44
                  # G(n-1)>G(n+1)
                  Subtract(x=w44, y=2) -> w45
                  Increment(x=w44) -> w46
                  Divide(x=w45, y=w46) -> w47
                  Add(w47, w34) -> w42
                  Multiply(w47, w47) -> w48
                  Subtract(x=1, y=w48) -> w49
                  Multiply(w47, Pi) -> w50
                  Sinc(x=w50) -> w51
                  Divide(x=w49, y=w51) -> w52
                  Multiply(w33, w52) -> w43
                }
                frame 1 {
                  # G(n-1)=G(n+1)
                  w42 = w34
                  w43 = w33
                }
                frame 2.. {
                  Divide(x=w33, y=w36) -> w53
                  Increment(x=w53) -> w54
                  Subtract(x=2, y=w53) -> w55
                  Divide(x=w55, y=w54) -> w56
                  Add(w56, w34) -> w42
                  Multiply(w56, w56) -> w57
                  Subtract(x=1, y=w57) -> w58
                  Multiply(w56, Pi) -> w59
                  Sinc(x=w59) -> w60
                  Divide(x=w58, y=w60) -> w61
                  # G(n-1)<G(n+1)
                  Multiply(w33, w61) -> w43
                }
              }
            }
          }
        }
        frame 2 {
          # This frame performs the second iteration to find an estimate for the tone
          # Frequency and Amplitude that is corrected for aliasing around DC and Fs/2
          sequence {
            frame 0 {
              # The 3 dominant BINS
              # are corrected for
              # aliasing
              # Given the first estimate,
              # correction for aliasing
              # can be calculated
              Round Toward Negative Infinity(x=w42) -> w62
              Decrement(x=w62) -> w63
              Array Index(array=w10) -> (out0[w62]=w64)
              Complex To Polar(r * e^(i*theta)=w64) -> (theta=w65)
              sequence {
                frame 0 {
                  Add(Pi, w65) -> w66
                  Negate(x=w66) -> w67
                  # aliasing
                  # around DC
                  s1 = w10  # shift register
                  for (N = 4) (iteration -> i1) {
                    Add(w63, i1) -> w68
                    Array Index(array=s1) -> (out0[w68]=w69)
                    Add(w68, w42) -> w70
                    Multiply(w70, w70) -> w71
                    Decrement(x=w71) -> w72
                    Multiply(w70, Pi) -> w73
                    Sinc(x=w73) -> w74
                    Divide(x=w74, y=w72) -> w75
                    Absolute Value(x=w75) -> w76
                    Multiply(w76, w43) -> w77
                    Polar To Complex(r=w77, theta=w67) -> (r * e^(i*theta)=w78)
                    Subtract(x=w69, y=w78) -> w79
                    Replace Array Subset(inArray=s1, w68, w79) -> w80
                    next s1 = w80
                  }
                }
                frame 1 {
                  Subtract(x=w11, y=w42) -> w81
                  Negate(x=w65) -> w82
                  # aliasing
                  # around Fs/2
                  s2 = s1  # shift register
                  for (N = 4) (iteration -> i2) {
                    Add(w63, i2) -> w83
                    Array Index(array=s2) -> (out0[w83]=w84)
                    Subtract(x=w83, y=w81) -> w85
                    Multiply(w85, w85) -> w86
                    Decrement(x=w86) -> w87
                    Multiply(w85, Pi) -> w88
                    Sinc(x=w88) -> w89
                    Divide(x=w89, y=w87) -> w90
                    Absolute Value(x=w90) -> w91
                    Multiply(w91, w43) -> w92
                    Polar To Complex(r=w92, theta=w82) -> (r * e^(i*theta)=w93)
                    Subtract(x=w84, y=w93) -> w94
                    Replace Array Subset(inArray=s2, w83, w94) -> w95
                    next s2 = w95
                  }
                }
              }
              Increment(x=w34) -> w96
              Array Index(array=s2) -> (out0[w96]=w97)
              Complex To Polar(r * e^(i*theta)=w97) -> (r=w98)
              Array Index(array=s2) -> (out0[w34]=w99)
              Complex To Polar(r * e^(i*theta)=w99) -> (r=w100)
              Decrement(x=w34) -> w101
              Array Index(array=s2) -> (out0[w101]=w102)
              Complex To Polar(r * e^(i*theta)=w102) -> (r=w103)
              Array Index(array=s2) -> (out0[w62]=w104)
              Complex To Polar(r * e^(i*theta)=w104) -> (theta=w105)
            }
            frame 1 {
              # Given the 3 dominant BINS, the exact
              # amplitude and frequency of the tone
              # can be calculated
              case (w41) {
                frame ..0 {
                  Divide(x=w100, y=w103) -> w108
                  # G(n-1)>G(n+1)
                  Subtract(x=w108, y=2) -> w109
                  Increment(x=w108) -> w110
                  Divide(x=w109, y=w110) -> w111
                  Multiply(w111, w111) -> w112
                  Subtract(x=1, y=w112) -> w113
                  Multiply(w111, Pi) -> w114
                  Sinc(x=w114) -> w115
                  Divide(x=w113, y=w115) -> w116
                  Multiply(w100, w116) -> w107
                  Add(w111, w34) -> w106
                }
                frame 1 {
                  # G(n-1)=G(n+1)
                  w106 = w34
                  w107 = w100
                }
                frame 2.. {
                  Divide(x=w100, y=w98) -> w117
                  Increment(x=w117) -> w118
                  Subtract(x=2, y=w117) -> w119
                  Divide(x=w119, y=w118) -> w120
                  Multiply(w120, w120) -> w121
                  Subtract(x=1, y=w121) -> w122
                  Multiply(w120, Pi) -> w123
                  # G(n-1)<G(n+1)
                  Sinc(x=w123) -> w124
                  Divide(x=w122, y=w124) -> w125
                  Multiply(w100, w125) -> w107
                  Add(w120, w34) -> w106
                }
              }
              Square Root(x=2) -> w126
              Multiply(w107, w126) -> w6
              Is Not A Number Or Path Or Refnum(number=w6) -> w127
              Multiply(w106, w20) -> w5
              Divide(x=$"sampling frequency", y=2) -> w128
              In Range And Coerce(lower limit=0, upper limit=w128, x=w5) -> (In Range?=w129)
              Not(x=w129) -> w130
              Logical Or(w127, w130) -> w131
              Concatenate Strings("Failed to detect tone amplitude", CarriageRet) -> w132
              Select(s=w127, t=w132, f="") -> w133
              Concatenate Strings("Failed to detect tone frequency", CarriageRet) -> w134
              Select(s=w130, t=w134, f="") -> w135
              Concatenate Strings(w133, w135) -> w136
            }
            frame 2 {
              Divide(x=180, y=Pi) -> w137
              Multiply(w137, w105) -> w138
              Quotient And Remainder(x=w106, y=1) -> (x-y*floor(x/y)=w139)
              Multiply(180, w139) -> w140
              Subtract(x=w138, y=w140) -> w141
              Add(w141, 90) -> w4
              case ($"export mode") {
                frame "none", Default {
                  w2 = f64[] []
                  w3 = c128[] []
                }
                frame "input signal" {
                  w2 = $"time signal in"
                  w3 = w10
                }
                frame "detected signal" {
                  call "Sine Pattern.gvi"(samples=w11, amplitude=w6, phase=w4, cycles=w106) -> (sinusoidal pattern=w2)
                  call "ma_FFT with Hanning.gvi"(time signal data=w2) -> (complex Hann spectrum=w3)
                }
                frame "residual signal" {
                  call "Sine Pattern.gvi"(samples=w11, amplitude=w6, phase=w106) -> (sinusoidal pattern=w142)
                  call "ma_FFT with Hanning.gvi"(time signal data=w142) -> (complex Hann spectrum=w143)
                  Subtract(x=w10, y=w143) -> w3
                  Subtract(x=$"time signal in", y=w142) -> w2
                }
              }
              Is Not A Number Or Path Or Refnum(number=w4) -> w144
              Logical Or(w144, w131) -> w145
              Concatenate Strings("Failed to detect tone phase", CarriageRet) -> w146
              Select(s=w144, t=w146, f="") -> w147
              Concatenate Strings(w136, w147) -> w148
              Property Node(instance in=T4 {all zero or empty}, "Element 1"=0, "Element 2"=w145, "Element 3"=w148) -> (instance out=w7)
            }
          }
        }
      }
      w1 = $"error in"
    }
    frame Error {
      w1 = $"error in"
      w2 = f64[] []
      w3 = c128[] []
      w4 = 0
      w5 = 0
      w6 = 0
      w7 = T4 {all zero or empty}
    }
  }
  $"complex spectrum out" <- w3
  $"time signal out" <- w2
  $"detected amplitude" <- w6
  $"detected frequency" <- w5
  $"detected phase (deg)" <- w4
  $"measurement info" <- w7
  $"error out" <- w1
