vi "FFT.gvi"   [LabVIEW NXG]
inputs:
  "FFT {X}": c128[]
  "shift?": bool
outputs:
  "X": f64[]
  "error": i32
diagram:
  Boolean To Integer(Boolean=$"shift?") -> (0, 1=w1)
  Native Method Call(shift=w1, xH in=$"FFT {X}") -> (return=w2, yH out=w3)
  $error <- w2
  $X <- w3
