vi "FM Tx-Rx.gvi"   [LabVIEW NXG]
panel controls:
  "IQ rate Tx": f64 = 500000
  "carrier frequency Tx": f64 = 400000000
  "gain Tx": f64
  "active antenna Tx": string = "TX/RX"
  "IQ rate Rx": f64 = 500000
  "carrier frequency Rx": f64 = 400000000
  "gain Rx": f64
  "active antenna Rx": string = "RX2"
  "Stop Tx": bool
  "Stop Rx": bool
  "Device names Tx": string
  "Device names Rx": string
  "msg. freq.": f64 = 1000
  "msg. amplitude": f64 = 1
  "delta f": f64 = 30000
  "Low cutoff freq": f64 = 10000
  "delta f_demod": f64 = 500
  "number of samples": f64 = 200000
panel indicators:
  "coerced IQ rate Rx": f64
  "coerced carrier frequency Rx": f64
  "coerced gain 2": f64
  "error out": error
  "Demod. Msg (Time domain)": waveform<f64>
  "Demod. Msg (Freq domain)": T1
  "Error Out_2": error
  "FM PSD": T1
  "Message PSD": T1
types:
  T1 = cluster{"f0": f64, "df": f64, "magnitude": f64[]}
diagram:
  w1 = $"number of samples"
  w2 = $"IQ rate Tx"
  call "niUSRP Open Tx Session.gvi"(Device names=$"Device names Tx") -> (Error Out=w3, Session handle=w4)
  call "niUSRP Configure Signal.gvi"(session handle=w4, IQ rate=w2, carrier frequency=$"carrier frequency Tx", gain=$"gain Tx", error in (no error)=w3, active antenna=$"active antenna Tx") -> (session handle out=w5, Error Out=w6)
  while {
    Build Cluster(w2, w1) -> w7
    call "Sine Waveform.gvi"(frequency=$"msg. freq.", amplitude=$"msg. amplitude", phase=0, sampling info=w7) -> (signal out=w8)
    Property Node(instance in=w8) -> ("Y"=w9, "dt"=w10, "t0"=w11)
    call "Integral x(t).gvi"(x=w9, dt=w10) -> (integral x=w12)
    Multiply(PiTimes2, $"delta f") -> w13
    Multiply(w12, w13) -> w14
    Sine And Cosine(x=w14) -> (cos(x)=w15, sin(x)=w16)
    Real And Imaginary To Complex(x=w15, y=w16) -> w17
    call "niUSRP Write Tx Data (CDB).gvi"(session handle=w5, data=w17, end of data?=$"Stop Tx", error in (no error)=w6) -> (session handle out=w18, Error Out=w19)
    Property Node(instance in=w19) -> ("status"=w20)
    Logical Or(w20, $"Stop Tx") -> w21
    Build Cluster(w17, w10, w11) -> w22
    call "FFT Power Spectrum for 1 Chan (CDB)3.gvi"(time signal=w22) -> (power spectrum=w23)
    $"FM PSD" <- w23
    call "FFT Power Spectrum and PSD for 1 Chan2.gvi"(time signal=w8) -> (power spectrum / psd=w24)
    $"Message PSD" <- w24
    stop if w21
  }
  call "niUSRP Close Session.gvi"(Handle in=w18, error in (no error)=w19) -> (Error Out=w25)
  $"error out" <- w25
  call "niUSRP Open Rx Session.gvi"(Device names=$"Device names Rx") -> (Session handle=w26)
  call "niUSRP Configure Signal.gvi"(session handle=w26, IQ rate=$"IQ rate Rx", carrier frequency=$"carrier frequency Rx", gain=$"gain Rx", active antenna=$"active antenna Rx") -> (session handle out=w27, coerced IQ rate=w28, coerced carrier frequency=w29, coerced gain=w30, Error Out=w31)
  $"coerced IQ rate Rx" <- w28
  $"coerced carrier frequency Rx" <- w29
  call "niUSRP Initiate.gvi"(session handle=w27, error in (no error)=w31) -> (session handle out=w32, Error Out=w33)
  while {
    To Quad Integer(number=w1) -> w34
    call "niUSRP Fetch Rx Data (CDB WDT).gvi"(session handle=w32, number of samples=w34, error in (no error)=w33) -> (session handle out=w35, data=w36, Error Out=w37)
    Property Node(instance in=w36) -> ("Y"=w38, "dt"=w39)
    Complex To Real Imaginary(x + iy=w38) -> (x=w40, y=w41)
    call "Derivative x(t).gvi"(x=w40, dt=w39) -> (dx/dt=w42)
    Multiply(w42, w41) -> w43
    Reciprocal(x=w39) -> w44
    call "Butterworth.gvi"(X=w43, sampling freq: fs=w44, low cutoff freq: fl=$"Low cutoff freq", filter type="Lowpass", order=5) -> (Filtered X=w45)
    call "AC & DC Estimator.gvi"(Signal (V)=w45) -> (DC estimate (V)=w46)
    Subtract(x=w45, y=w46) -> w47
    Multiply(PiTimes2, $"delta f_demod") -> w48
    Divide(x=w47, y=w48) -> w49
    Build Waveform Node(Y=w49, dt=w39) -> (output waveform=w50)
    $"Demod. Msg (Time domain)" <- w50
    call "FFT Power Spectrum and PSD for 1 Chan.gvi"(time signal=w50) -> (power spectrum / psd=w51)
    $"Demod. Msg (Freq domain)" <- w51
    Property Node(instance in=w37) -> ("status"=w52)
    Logical Or(w52, $"Stop Rx") -> w53
    stop if w53
  }
  call "niUSRP Abort.gvi"(Handle in=w35, error in (no error)=w37) -> (Handle out=w54, Error Out=w55)
  call "niUSRP Close Session.gvi"(Handle in=w54, error in (no error)=w55) -> (Error Out=w56)
  $"Error Out_2" <- w56
  $"coerced gain 2" <- w30
