vi "Multitone generator.gvi"   [LabVIEW NXG]
inputs:
  "tone frequencies": f64[] = [100, 200, 300, 400]
  "tone amplitudes": f64[] = [1, 1, 1, 1]
  "tone phases": f64[] = [137.63, 330.58, 66.37, 291.58]
  "error in (no error)": error
  "reset signal": bool
  "amplitude": f64 = -1
  "sampling info": cluster{"Fs": f64, "#s": f64} = {"Fs"=1000, "#s"=1000}
  "coerce frequencies?": bool
outputs:
  "signal out": waveform<f64>
  "crest factor": f64
  "actual tone frequencies": f64[]
  "error out": error
diagram:
  Property Node(instance in=$"sampling info") -> ("#s"=w1, "Fs"=w2)
  To Long Integer(number=w1) -> w3
  Array Size(array=$"tone amplitudes") -> (size(s)=w4)
  call "ma_MultitoneParamsCheck.gvi"(Tone Amplitudes=$"tone amplitudes", Tone Frequencies=$"tone frequencies", Sampling Rate=w2, error in (no error)=$"error in (no error)", Samples=w3, Phases=$"tone phases", coerce frequencies?=$"coerce frequencies?") -> (Tone Amplitudes out=w5, Tone Frequencies out=w6, Phases out=w7, error out=w8)
  case (w8) {
    frame No Error {
      Is First Call() -> w13
      Logical Or($"reset signal", w13) -> w14
      s1 = uninitialised  # shift register
      s2 = uninitialised  # shift register
      s3 = uninitialised  # shift register
      while {
        case (w14) {
          frame False, Default {
            w9 = w8
            w15 = s2
            w16 = s3
          }
          frame True {
            Divide(x=w2, y=w3) -> w17
            Divide(x=w6, y=w17) -> w18
            Multiply(w3, w5) -> w19
            Divide(x=w19, y=2) -> w20
            Quotient And Remainder(x=w3, y=2) -> (floor(x/y)=w21)
            Increment(x=w21) -> w22
            Initialize Array(element=0, size=w22) -> w23
            Initialize Array(element=0, size=w22) -> w24
            s4 = w23  # shift register
            s5 = w24  # shift register
            for (N = w4) {
              w25 = each element of w18
              w26 = each element of w20
              w27 = each element of w7
              Array Index(array=s4) -> (out0[w25]=w28)
              Array Index(array=s5) -> (out0[w25]=w29)
              Is Equal To 0(x=w28) -> w30
              Subtract(x=w27, y=1.57079632679) -> w31
              case (w30) {
                frame False, Default {
                  Polar To Complex(r=w28, theta=w29) -> (r * e^(i*theta)=w34)
                  Polar To Complex(r=w26, theta=w31) -> (r * e^(i*theta)=w35)
                  Add(w34, w35) -> w36
                  Complex To Polar(r * e^(i*theta)=w36) -> (r=w32, theta=w33)
                }
                frame True {
                  w32 = w26
                  w33 = w31
                }
              }
              Replace Array Subset(inArray=s4, w25, w32) -> w37
              Replace Array Subset(inArray=s5, w25, w33) -> w38
              next s4 = w37
              next s5 = w38
            }
            Polar To Complex(r=s4, theta=s5) -> (r * e^(i*theta)=w39)
            # Even/Odd
            # test
            # Impulse Amplitudes
            # Impulse Phases
            # Complex numbers representing
            # Impulse amplitudes and phases
            # Impulse Freqs
            # Use symmetry for even
            # or odd case to create other
            # half of impulses
            Logical And(1, w3) -> w40
            Complex Conjugate(x + iy=w39) -> w41
            Subtract(x=w22, y=2) -> w42
            case (w40) {
              frame 0, Default {
                # Even Case
                Array Subset(array=w41, index0=1, length0=w42) -> w44
                Reverse 1D Array(array=w44) -> (reversed array=w43)
              }
              frame 1 {
                # Odd case
                Array Subset(array=w41, index0=1) -> w45
                Reverse 1D Array(array=w45) -> (reversed array=w43)
              }
            }
            Build Array[ConcatenateInputs=True](w39, w43) -> w46
            call "FFT.gvi"(FFT {X}=w46) -> (X=w47, error=w48)
            call "Scale Multitone.gvi"(multitone in=w47, scaling method="peak detect", amplitude=$amplitude) -> (multitoneout=w16, crest factor=w15)
            call "ma_basicErrorCode2ErrorCluster.gvi"(Error Code=w48, subVI name="Inverse Real FFT.vi", error in (no error)=w8) -> (Error Out=w9)
          }
        }
        call "ma_Updatet0 timestamp.gvi"(Reset Generation=w14, tf previous=s1, sampling rate (S/s)=w2, samples=w3) -> (t0=w49, tf new=w50)
        Reciprocal(x=w2) -> w51
        Build Waveform Node(Y=w16, dt=w51, t0=w49) -> (output waveform=w11)
        next s1 = w50
        next s2 = w15
        next s3 = w16
        continue if FALSE
      }
      w10 = s2
      w12 = w6
    }
    frame Error {
      To Time Stamp(number=0) -> w52
      Build Waveform Node(Y=f64[] [], dt=0, t0=w52) -> (output waveform=w11)
      w9 = w8
      w10 = NaN
      w12 = default
    }
  }
  $"crest factor" <- w10
  $"signal out" <- w11
  Coerce To Type(type=no error, x=w9) -> w53
  $"error out" <- w53
  $"actual tone frequencies" <- w12
