vi "Peak detector no state.gvi"   [LabVIEW NXG]
inputs:
  "X": f64[]
  "error in": error
  "threshold": f64
  "width": i32 = 3
  "peaks/valleys": enum{"Peaks", "Valleys"} = "Peaks"
  "state info": cluster{"PEAKINT": T1, "SavedData": f64[]}
  "initialize (T)": bool = TRUE
  "end of data (T)": bool = TRUE
outputs:
  "state info_2": cluster{"PEAKINT": T1, "SavedData": f64[]}
  "error out": error
  "# found": i32
  "Locations": f64[]
  "Amplitudes": f64[]
  "2nd Derivatives": f64[]
types:
  T1 = cluster{"Span": i32, "Index": i32, "NHistoryPts": i32, "Len": i32, "PrevSign": i32, "unused": i32, "RinvQt (pointer)": u32, "FitBuffer (pointer)": u32, "History (pointer)": u32, "PrevCoeff (pointer)": u32, "Data (pointer)": u32, "slack for RinvQt": u32, "slack for FitBuffer": u32, "slack for History": u32, "slack for PrevCoeff": u32, "slack for Data": u32}
  T2 = cluster{"X": f64[], "threshold": f64, "upper limit": i32, "peaks/valleys": enum{"Peaks", "Valleys"}, "Array Constant": f64[], "Array Constant_2": f64[], "Array Constant_3": f64[], "Element 8": i32, "Element 9": i32}
diagram:
  case ($"error in") {
    frame No Error {
      In Range And Coerce[IncludeHighLimit=True](lower limit=3, upper limit=2147483647, x=$width) -> (coerced(x)=w2)
      Select(s=$"end of data (T)", t=4, f=0) -> w3
      Select(s=$"initialize (T)", t=1, f=2) -> w4
      Add(w3, w4) -> w5
      Property Node(instance in=T2 {all zero or empty}, "X"=$X, "threshold"=$threshold, "upper limit"=w2, "peaks/valleys"=$"peaks/valleys", "Array Constant"=f64[] [], "Array Constant_2"=f64[] [], "Array Constant_3"=f64[] [], "Element 8"=0, "Element 9"=w5) -> (instance out=w6)
      Property Node(instance in=$"state info") -> ("PEAKINT"=w7, "SavedData"=w8)
      Native Method Call(PeakApp in=w6, UnnamedParameter1 in=w8, UnnamedParameter2 in=0, pPEAKINT in=w7) -> (PeakApp out=w9, UnnamedParameter1 out=w10, UnnamedParameter2 out=w11, pPEAKINT out=w12)
      Property Node(instance in=w9) -> ("Array Constant"=w13, "Array Constant_2"=w14, "Array Constant_3"=w15, "Element 8"=w16)
      $Amplitudes <- w14
      $"2nd Derivatives" <- w15
      $"# found" <- w16
      Property Node(instance in=$"state info", "PEAKINT"=w12, "SavedData"=w10) -> (instance out=w17)
      $"state info_2" <- w17
      call "ma_patchErrorCode or Caller as Source.gvi"(error code=w11, error in (no error)=$"error in") -> (Error Out=w1)
      $Locations <- w13
    }
    frame Error {
      w1 = $"error in"
    }
  }
  Coerce To Type(type=no error, x=w1) -> w18
  $"error out" <- w18
