vi "Power.gvi"   [LabVIEW NXG]
inputs:
  "waveform in": waveform<f64> = {dt=1, Y=[]}
outputs:
  "signal power": f64
diagram:
  # Computes the power of a sinusoid in time
  Property Node(instance in=$"waveform in") -> ("dt"=w1, "Y"=w2)
  # Computes the time for which we need to divide
  Array Size(array=w2) -> (size(s)=w3)
  To Double Precision Float(number=w3) -> w4
  Multiply(w1, w4) -> w5
  Square(x=w2) -> w6
  call "1D Numeric Integration.gvi"(Input Array=w6, dt=w1) -> (result=w7)
  Divide(x=w7, y=w5) -> w8
  $"signal power" <- w8
