vi "Rx.gvi"   [LabVIEW NXG]
panel controls:
  "Device name": string
  "IQ rate": f64 = 100000
  "carrier frequency": f64 = 100000
  "gain": f64
  "number of samples": i64 = 100000
  "STOP": bool
panel indicators:
  "coerced IQ rate": f64
  "coerced carrier frequency": f64
  "coerced gain": f64
  "Error Out": error
diagram:
  call "niUSRP Open Rx Session.gvi"(Device names=$"Device name") -> (Error Out=w1, Session handle=w2)
  call "niUSRP Configure Signal.gvi"(session handle=w2, IQ rate=$"IQ rate", carrier frequency=$"carrier frequency", gain=$gain, error in (no error)=w1) -> (session handle out=w3, coerced IQ rate=w4, coerced carrier frequency=w5, coerced gain=w6, Error Out=w7)
  call "niUSRP Initiate.gvi"(session handle=w3, error in (no error)=w7) -> (session handle out=w8, Error Out=w9)
  while {
    call "niUSRP Fetch Rx Data (I16).gvi"(session handle=w8, number of samples=$"number of samples", error in (no error)=w9) -> (session handle out=w10, Error Out=w11)
    Property Node(instance in=w11) -> ("status"=w12)
    Logical Or(w12, $STOP) -> w13
    stop if w13
  }
  call "niUSRP Abort.gvi"(Handle in=w10, error in (no error)=w11) -> (Handle out=w14, Error Out=w15)
  call "niUSRP Close Session.gvi"(Handle in=w14, error in (no error)=w15) -> (Error Out=w16)
  $"Error Out" <- w16
  $"coerced IQ rate" <- w4
  $"coerced carrier frequency" <- w5
  $"coerced gain" <- w6
