vi "SINAD Analyzer 1 Chan.gvi"   [LabVIEW NXG]
inputs:
  "signal in": waveform<f64> = {dt=1, Y=[]}
  "export mode": T1 = "none"
  "error in (no error)": error
  "advanced search": T4 = {"approx freq. (optional)"=-1, "search (+/- % of Fsampl.)"=5}
outputs:
  "detected fundamental frequency": f64
  "SINAD (dB)": f64
  "THD Plus Noise": f64
  "error out": error
  "exported signals": T3
  "measurement info": T5
types:
  T1 = enum{"none", "input signal", "fundamental signal", "residual signal"}
  T2 = cluster{"f0": f64, "df": f64, "dB Spectrum (Hann)": f64[]}
  T3 = cluster{"exported time signal": DoubleAnalogWaveform, "exported spectrum (dB)": T2}
  T4 = cluster{"approx freq. (optional)": f64, "search (+/- % of Fsampl.)": f64}
  T5 = cluster{"uncertainty": f64, "Warning": bool, "comments": string}
  T6 = cluster{"Element 1": f64, "Element 2": f64, "Element 3": f64[]}
  T7 = cluster{"signal in": DoubleAnalogWaveform, "Element 2": T6}
diagram:
  call "ma_Check Waveform Timing.gvi"(signal in=$"signal in")
  case ($"error in (no error)") {
    frame No Error {
      Property Node(instance in=$"signal in") -> ("Y"=w2)
      call "Std Deviation and Variance.gvi"(X=w2, Weighting (Sample)="Population") -> (standard deviation=w3)
      call "ma_FFT with Hanning.gvi"(time signal data=w2) -> (complex Hann spectrum=w4, FFT size=w5)
      Property Node(instance in=$"signal in") -> ("dt"=w6)
      Reciprocal(x=w6) -> w7
      call "Extract Single Tone Information from Hann Spectrum.gvi"(complex spectrum in=w4, FFT size=w5, export mode="detected signal", sampling frequency=w7, error in=$"error in (no error)", time signal in=w2, advanced search=$"advanced search") -> (complex spectrum out=w8, detected frequency=w9, error out=w1, time signal out=w10, measurement info=w11)
      Subtract(x=w2, y=w10) -> w12
      call "Std Deviation and Variance.gvi"(X=w12, Weighting (Sample)="Population") -> (standard deviation=w13)
      Divide(x=w3, y=w13) -> w14
      Reciprocal(x=w14) -> w15
      $"THD Plus Noise" <- w15
      Logarithm Base 10(x=w14) -> w16
      Multiply(w16, 20) -> w17
      $"SINAD (dB)" <- w17
      case ($"export mode") {
        frame "none", Default {
          w18 = f64[] []
          w19 = c128[] []
        }
        frame "input signal" {
          w18 = w2
          w19 = w4
        }
        frame "fundamental signal" {
          w18 = w10
          w19 = w8
        }
        frame "residual signal" {
          Subtract(x=w4, y=w8) -> w19
          w18 = w12
        }
      }
      Property Node(instance in=$"signal in", "Y"=w18) -> (instance out=w20)
      w21 = T7 {"signal in"={dt=1, Y=[]}, "Element 2"={"Element 1"=0, "Element 2"=0, "Element 3"=[]}}
      Divide(x=w7, y=w5) -> w22
      Complex To Polar(r * e^(i*theta)=w19) -> (r=w23)
      Logarithm Base 10(x=w23) -> w24
      Multiply(w24, 20) -> w25
      Property Node(instance in=T6 {all zero or empty}, "Element 1"=0, "Element 2"=w22, "Element 3"=w25) -> (instance out=w26)
      Property Node(instance in=w21, "signal in"=w20, "Element 2"=w26) -> (instance out=w27)
      $"exported signals" <- w27
      $"detected fundamental frequency" <- w9
      $"measurement info" <- w11
    }
    frame Error {
      w1 = $"error in (no error)"
    }
  }
  Coerce To Type(type=no error, x=w1) -> w28
  $"error out" <- w28
