vi "Scale Multitone.gvi"   [LabVIEW NXG]
inputs:
  "multitone in": f64[]
  "scaling method": enum{"max absolute value", "peak detect"} = "peak detect"
  "amplitude": f64
outputs:
  "multitoneout": f64[]
  "crest factor": f64
diagram:
  # actual peak value
  case ($"scaling method") {
    frame "max absolute value", Default {
      Array Max And Min(array=$"multitone in") -> (max value=w1)
    }
    frame "peak detect" {
      call "Peak detector no state.gvi"(X=$"multitone in", threshold=-Inf, peaks/valleys="Peaks") -> (Amplitudes=w2)
      Absolute Value(x=w2) -> w3
      Array Max And Min(array=w3) -> (max value=w4)
      call "Peak detector no state.gvi"(X=$"multitone in", threshold=+Inf, peaks/valleys="Valleys") -> (Amplitudes=w5)
      Absolute Value(x=w5) -> w6
      Array Max And Min(array=w6) -> (max value=w7)
      Max And Min(x=w4, y=w7) -> (max(x,y)=w1: f64)
    }
  }
  Is Greater Or Equal To 0(x=$amplitude) -> w8
  Select(s=w8, t=$amplitude, f=w1) -> w9
  Divide(x=w9, y=w1) -> w10
  Is Not Equal To 0(x=w1) -> w11
  Select(s=w11, t=w10, f=1) -> w12
  Multiply($"multitone in", w12) -> w13
  $multitoneout <- w13
  call "RMS (DBL).gvi"(x=$"multitone in") -> (rms value=w14)
  Divide(x=w1, y=w14) -> w15
  $"crest factor" <- w15
