vi "Tx.gvi"   [LabVIEW NXG]
panel controls:
  "Device name": string
  "IQ rate": f64 = 100000
  "carrier frequency": f64 = 100000
  "gain": f64
  "active antenna": string
  "stop": bool
panel indicators:
  "coerced IQ rate": f64
  "coerced carrier frequency": f64
  "coerced gain": f64
  "Error Out": error
diagram:
  call "niUSRP Open Tx Session.gvi"(Device names=$"Device name") -> (Error Out=w1, Session handle=w2)
  call "niUSRP Configure Signal.gvi"(session handle=w2, IQ rate=$"IQ rate", carrier frequency=$"carrier frequency", gain=$gain, error in (no error)=w1, active antenna=$"active antenna") -> (session handle out=w3, coerced IQ rate=w4, coerced carrier frequency=w5, coerced gain=w6, Error Out=w7)
  $"coerced IQ rate" <- w4
  $"coerced carrier frequency" <- w5
  while {
    call "niUSRP Write Tx Data (2D CDB).gvi"(session handle=w3, end of data?=$stop, error in (no error)=w7) -> (session handle out=w8, Error Out=w9)
    Property Node(instance in=w9) -> ("status"=w10)
    Logical Or(w10, $stop) -> w11
    stop if w11
  }
  call "niUSRP Close Session.gvi"(Handle in=w8, error in (no error)=w9) -> (Error Out=w12)
  $"Error Out" <- w12
  $"coerced gain" <- w6
