vi "USRP_AM_Rx.gvi"   [LabVIEW NXG]
inputs:
  "Device name": string
  "IQ rate": f64 = 100000
  "carrier frequency": f64 = 100000
  "gain": f64
  "number of samples": i64 = 100000
  "STOP": bool
  "active antenna": string
outputs:
  "coerced IQ rate": f64
  "coerced carrier frequency": f64
  "coerced gain": f64
  "Error Out": error
  "PSD": T1
  "Signal M": f64[]
panel controls:
  "filter type": T2 = "Lowpass"
panel indicators:
  "Signal M2": f64[]
  "K": f64
types:
  T1 = cluster{"f0": f64, "df": f64, "magnitude": f64[]}
  T2 = enum{"Lowpass", "Highpass", "Bandpass", "Bandstop"}
diagram:
  call "niUSRP Open Rx Session.gvi"(Device names=$"Device name") -> (Error Out=w1, Session handle=w2)
  call "niUSRP Configure Signal.gvi"(session handle=w2, IQ rate=$"IQ rate", carrier frequency=$"carrier frequency", gain=$gain, error in (no error)=w1, active antenna=$"active antenna") -> (session handle out=w3, coerced IQ rate=w4, coerced carrier frequency=w5, coerced gain=w6, Error Out=w7)
  call "niUSRP Initiate.gvi"(session handle=w3, error in (no error)=w7) -> (session handle out=w8, Error Out=w9)
  while {
    call "niUSRP Fetch Rx Data (CDB WDT).gvi"(session handle=w8, number of samples=$"number of samples", error in (no error)=w9) -> (session handle out=w10, data=w11, Error Out=w12)
    Property Node(instance in=w12) -> ("status"=w13)
    Logical Or(w13, $STOP) -> w14
    Property Node(instance in=w11) -> ("Y"=w15, "t0"=w16, "dt"=w17)
    Complex To Real Imaginary(x + iy=w15) -> (x=w18)
    call "AC & DC Estimator.gvi"(Signal (V)=w18) -> (DC estimate (V)=w19)
    Subtract(x=w18, y=w19) -> w20
    Build Waveform Node(Y=w20, dt=w17, t0=w16) -> (output waveform=w21)
    call "Butterworth Filter (DBL).gvi"(filter type=$"filter type", X=w21) -> (Filtered X=w22)
    Absolute Value(x=w22) -> w23
    Array Max And Min(array=w23) -> (max value=w24)
    $K <- w24
    $"Signal M2" <- w20
    $"Signal M" <- w20
    call "FFT Power Spectrum and PSD for 1 Chan2.gvi"(time signal=w21) -> (power spectrum / psd=w25)
    $PSD <- w25
    stop if w14
  }
  call "niUSRP Abort.gvi"(Handle in=w10, error in (no error)=w12) -> (Handle out=w26, Error Out=w27)
  call "niUSRP Close Session.gvi"(Handle in=w26, error in (no error)=w27) -> (Error Out=w28)
  $"Error Out" <- w28
  $"coerced IQ rate" <- w4
  $"coerced carrier frequency" <- w5
  $"coerced gain" <- w6
