vi "USRP_AM_Tx.gvi"   [LabVIEW NXG]
inputs:
  "Device name": string
  "IQ rate": f64 = 100000
  "carrier frequency": f64 = 100000
  "gain": f64
  "active antenna": string
  "message frequency": f64 = 10
  "sampling info": cluster{"Fs": f64, "#s": f64} = {"Fs"=1000, "#s"=1000}
outputs:
  "coerced IQ rate": f64
  "coerced carrier frequency": f64
  "coerced gain": f64
  "Error Out": error
panel controls:
  "STOP": bool
  "amplitude": f64 = 1
diagram:
  call "niUSRP Open Tx Session.gvi"(Device names=$"Device name") -> (Error Out=w1, Session handle=w2)
  call "niUSRP Configure Signal.gvi"(session handle=w2, IQ rate=$"IQ rate", carrier frequency=$"carrier frequency", gain=$gain, error in (no error)=w1, active antenna=$"active antenna") -> (session handle out=w3, coerced IQ rate=w4, coerced carrier frequency=w5, coerced gain=w6, Error Out=w7)
  $"coerced IQ rate" <- w4
  $"coerced carrier frequency" <- w5
  while {
    call "Sine Waveform.gvi"(frequency=$"message frequency", amplitude=$amplitude, sampling info=$"sampling info") -> (signal out=w8)
    Waveform Add(w8, 1) -> w9
    Add(1, $amplitude) -> w10
    Waveform Divide(x=w9, y=w10) -> w11
    Property Node(instance in=w11) -> ("Y"=w12)  # Waveform Properties
    Real And Imaginary To Complex(x=w12, y=0) -> w13
    call "niUSRP Write Tx Data (CDB).gvi"(session handle=w3, data=w13, end of data?=$STOP, error in (no error)=w7) -> (session handle out=w14, Error Out=w15)
    Property Node(instance in=w15) -> ("status"=w16)
    Logical Or(w16, $STOP) -> w17
    stop if w17
  }
  call "niUSRP Close Session.gvi"(Handle in=w14, error in (no error)=w15) -> (Error Out=w18)
  $"Error Out" <- w18
  $"coerced gain" <- w6
