vi "Uniform White Noise (obs 90).gvi"   [LabVIEW NXG]
inputs:
  "samples": i32 = 128
  "amplitude": f64 = 1
  "seed": i32 = -1
outputs:
  "uniform white noise": f64[]
  "error": i32
types:
  T1 = cluster{"xSeed": i32, "ySeed": i32, "zSeed": i32}
diagram:
  Is First Call() -> w1
  s1 = uninitialised  # shift register
  while {
    case (w1) {
      frame False, Default {
        w2 = s1
        w3 = $seed
      }
      frame True {
        Random Number() -> (number (0 to 1)=w4)
        Multiply(w4, 0x3FFF) -> w5
        To Long Integer(number=w5) -> w6
        Is Greater Than 0(x=$seed) -> w7
        Select(s=w7, t=$seed, f=w6) -> w3
        w2 = T1 {"xSeed"=1234, "ySeed"=2345, "zSeed"=3456}
      }
    }
    Native Method Call(ampl in=$amplitude, dsperr in=0, rng_state in=w2, size in=$samples, theSeed in=w3) -> (dsperr out=w8, rng_state out=w9, xH out=w10)
    $"uniform white noise" <- w10
    next s1 = w9
    stop if TRUE
  }
  $error <- w8
