vi "BPSKRxTemplate.gvi"   [LabVIEW NXG]
panel controls:
  "IQ rate": f64 = 200000
  "carrier frequency": f64 = 915000000
  "gain (dB)": f64
  "active antenna": string = "RX2"
  "message length (bits)": i64 = 1000
  "symbol rate (sym/s)": i64 = 10000
  "Device names": string
panel indicators:
  "actual IQ rate": f64
  "actual carrier frequency": f64
  "actual gain (dB)": f64
  "error out": error
  "Baseband Output": cluster{"t0": f64, "dt": f64, "Y": f64[]}
  "Output bits": f64[]
  "BER": f64
  "trigger found?": bool
diagram:
  call "niUSRP Open Rx Session.gvi"(Device names=$"Device names") -> (Error Out=w1, Session handle=w2)
  call "niUSRP Configure Signal.gvi"(session handle=w2, IQ rate=$"IQ rate", carrier frequency=$"carrier frequency", gain=$"gain (dB)", error in (no error)=w1, active antenna=$"active antenna") -> (session handle out=w3, coerced IQ rate=w4, coerced carrier frequency=w5, coerced gain=w6, Error Out=w7)
  Subtract(x=w5, y=20000) -> w8
  Property Node(instance in=w3, "Configuration:Advanced:LO Frequency"=w8) -> (instance out=w9)
  call "niUSRP Initiate.gvi"(session handle=w9, error in (no error)=w7) -> (session handle out=w10, Error Out=w11)
  call "niUSRP Fetch Rx Data (CDB Cluster).gvi"(session handle=w10, error in (no error)=w11) -> (session handle out=w12, data=w13)
  # Estimate Phase
  Property Node(instance in=w13) -> ("dt"=w14)
  # Demodulate
  # Matched Filter
  w15 = cluster{"t0": f64, "dt": f64, "Y": f64[]} {all zero or empty}
  Property Node(instance in=w15, "dt"=w14) -> (instance out=w16)  # Cluster Properties
  # Pulse Sync
  $"Baseband Output" <- w16
  call "niUSRP Abort.gvi"(Handle in=w12) -> (Handle out=w17, Error Out=w18)
  call "niUSRP Close Session.gvi"(Handle in=w17, error in (no error)=w18) -> (Error Out=w19)
  call "Simple Error Handler.gvi"(error in=w19) -> (error out=w20)
  $"error out" <- w20
  # Frame Sync
  # Detection & Symbol Mapping
  Array Subset() -> w21
  # BER
  $"Output bits" <- w21
  # Sample
  Property Node()
  call "MT Calculate BER After Trigger (Fibonacci PN Sequence).gvi"(input bit stream=w21, BER trigger threshold=0.4) -> (BER=w22, trigger found?=w23)
  $BER <- w22
  $"actual IQ rate" <- w4
  $"trigger found?" <- w23
  $"actual carrier frequency" <- w5
  # no. samples
  $"actual gain (dB)" <- w6
  # samples/symbol
  Divide(x=w4, y=$"symbol rate (sym/s)")
