vi "BPSKTxTemplate.gvi"   [LabVIEW NXG]
panel controls:
  "IQ rate": f64 = 200000
  "carrier frequency": f64 = 915000000
  "gain (dB)": f64
  "active antenna": string = "TX1"
  "message length (bits)": i32 = 1000
  "symbol rate (sym/s)": i32 = 10000
  "stop": bool
  "Device names": string
panel indicators:
  "actual IQ rate": f64
  "actual carrier frequency": f64
  "actual gain (dB)": f64
  "error out": error
  "source bit stream": i8[]
  "Baseband Waveform": waveform<f64>
  "Power Spectrum": T1
types:
  T1 = cluster{"f0": f64, "df": f64, "magnitude": f64[]}
diagram:
  call "niUSRP Open Tx Session.gvi"(Device names=$"Device names") -> (Error Out=w1, Session handle=w2)
  call "niUSRP Configure Signal.gvi"(session handle=w2, IQ rate=$"IQ rate", carrier frequency=$"carrier frequency", gain=$"gain (dB)", error in (no error)=w1, active antenna=$"active antenna") -> (session handle out=w3, coerced IQ rate=w4, coerced carrier frequency=w5, coerced gain=w6, Error Out=w7)
  # Pulse Shaping
  Reciprocal(x=w4) -> w8
  # Modulation
  w9 = cluster{"t0": timestamp, "dt": f64, "Y": c128[]} {all zero or empty}
  Property Node(instance in=w9, "dt"=w8) -> (instance out=w10)
  call "FFT Power Spectrum for 1 Chan (CDB)2.gvi"(time signal=w10, dB On (F)=TRUE) -> (power spectrum=w11, Error Out=w12)
  while {
    call "niUSRP Write Tx Data (CDB).gvi"(session handle=w3, end of data?=$stop, error in (no error)=w12) -> (session handle out=w13, Error Out=w14)
    Logical Or(w14, $stop) -> w15
    stop if w15
  }
  call "niUSRP Close Session.gvi"(Handle in=w13, error in (no error)=w14) -> (Error Out=w16)
  call "Simple Error Handler.gvi"(error in=w16) -> (error out=w17)
  $"error out" <- w17
  call "MT Generate Bits (Fibonacci, PN Order).gvi"(total bits=$"message length (bits)", error in=w7) -> (output bit stream=w18)
  # Symbol Mapping
  # Framing
  # Upsampling
  $"source bit stream" <- w18
  Build Waveform Node(dt=w8) -> (output waveform=w19)
  $"Baseband Waveform" <- w19
  To Double Precision Float(number=w18)
  $"actual IQ rate" <- w4
  $"Power Spectrum" <- w11
  $"actual carrier frequency" <- w5
  $"actual gain (dB)" <- w6
  # Upsampling Factor
  Divide(x=w4, y=$"symbol rate (sym/s)")
