vi "BPSK_Tx_Rx_Template.gvi"   [LabVIEW NXG]
panel controls:
  "IQ rate": f64 = 200000
  "carrier frequency": f64 = 915000000
  "gain (dB)": f64
  "active antenna": string = "TX1"
  "message length (bits)": i32 = 1000
  "symbol rate (sym/s)": i32 = 10000
  "stop": bool
  "Device names": string
  "IQ rate_2": f64 = 200000
  "carrier frequency_2": f64 = 915000000
  "gain (dB)": f64
  "active antenna_2": string = "RX2"
  "message length (bits)_2": i64 = 1000
  "symbol rate (sym/s)_2": i64 = 10000
  "Device names_2": string
panel indicators:
  "actual IQ rate": f64
  "actual carrier frequency": f64
  "actual gain (dB)": f64
  "error out": error
  "source bit stream": i8[]
  "Baseband Waveform": waveform<f64>
  "Power Spectrum": T1
  "actual IQ rate_2": f64
  "actual carrier frequency_2": f64
  "actual gain (dB)_2": f64
  "error out_2": error
  "Baseband Output": cluster{"t0": f64, "dt": f64, "Y": f64[]}
  "Output bits": f64[]
  "BER": f64
  "trigger found?": bool
types:
  T1 = cluster{"f0": f64, "df": f64, "magnitude": f64[]}
diagram:
  call "niUSRP Open Tx Session.gvi"(Device names=$"Device names") -> (Error Out=w1, Session handle=w2)
  call "niUSRP Configure Signal.gvi"(session handle=w2, IQ rate=$"IQ rate", carrier frequency=$"carrier frequency", gain=$"gain (dB)", error in (no error)=w1, active antenna=$"active antenna") -> (session handle out=w3, coerced IQ rate=w4, coerced carrier frequency=w5, coerced gain=w6, Error Out=w7)
  # Pulse Shaping
  Reciprocal(x=w4) -> w8
  # Modulation
  w9 = cluster{"t0": timestamp, "dt": f64, "Y": c128[]} {all zero or empty}
  Property Node(instance in=w9, "dt"=w8) -> (instance out=w10)
  call "FFT Power Spectrum for 1 Chan (CDB)2.gvi"(time signal=w10, dB On (F)=TRUE) -> (power spectrum=w11, Error Out=w12)
  while {
    call "niUSRP Write Tx Data (CDB).gvi"(session handle=w3, end of data?=$stop, error in (no error)=w12) -> (session handle out=w13, Error Out=w14)
    Logical Or(w14, $stop) -> w15
    stop if w15
  }
  call "niUSRP Close Session.gvi"(Handle in=w13, error in (no error)=w14) -> (Error Out=w16)
  call "Simple Error Handler.gvi"(error in=w16) -> (error out=w17)
  $"error out" <- w17
  call "MT Generate Bits (Fibonacci, PN Order).gvi"(total bits=$"message length (bits)", error in=w7) -> (output bit stream=w18)
  # Transmitter Template
  # Symbol Mapping
  # Framing
  # Upsampling
  $"source bit stream" <- w18
  Build Waveform Node(dt=w8) -> (output waveform=w19)
  $"Baseband Waveform" <- w19
  To Double Precision Float(number=w18)
  $"actual IQ rate" <- w4
  $"Power Spectrum" <- w11
  $"actual carrier frequency" <- w5
  $"actual gain (dB)" <- w6
  # Upsampling Factor
  Divide(x=w4, y=$"symbol rate (sym/s)")
  call "niUSRP Open Rx Session.gvi"(Device names=$"Device names_2") -> (Error Out=w20, Session handle=w21)
  call "niUSRP Configure Signal.gvi"(session handle=w21, IQ rate=$"IQ rate_2", carrier frequency=$"carrier frequency_2", gain=$"gain (dB)", error in (no error)=w20, active antenna=$"active antenna_2") -> (session handle out=w22, coerced IQ rate=w23, coerced carrier frequency=w24, coerced gain=w25, Error Out=w26)
  Subtract(x=w24, y=20000) -> w27
  Property Node(instance in=w22, "Configuration:Advanced:LO Frequency"=w27) -> (instance out=w28)
  call "niUSRP Initiate.gvi"(session handle=w28, error in (no error)=w26) -> (session handle out=w29, Error Out=w30)
  call "niUSRP Fetch Rx Data (CDB Cluster).gvi"(session handle=w29, error in (no error)=w30) -> (session handle out=w31, data=w32)
  # Receiver Template
  # Estimate Phase
  Property Node(instance in=w32) -> ("dt"=w33)
  # Demodulate
  # Matched Filter
  w34 = cluster{"t0": f64, "dt": f64, "Y": f64[]} {all zero or empty}
  Property Node(instance in=w34, "dt"=w33) -> (instance out=w35)  # Cluster Properties
  # Pulse Sync
  $"Baseband Output" <- w35
  call "niUSRP Abort.gvi"(Handle in=w31) -> (Handle out=w36, Error Out=w37)
  call "niUSRP Close Session.gvi"(Handle in=w36, error in (no error)=w37) -> (Error Out=w38)
  call "Simple Error Handler.gvi"(error in=w38) -> (error out=w39)
  $"error out_2" <- w39
  # Frame Sync
  # Detection & Symbol Mapping
  Array Subset() -> w40
  # BER
  $"Output bits" <- w40
  # Sample
  Property Node()
  call "MT Calculate BER After Trigger (Fibonacci PN Sequence).gvi"(input bit stream=w40, BER trigger threshold=0.4) -> (BER=w41, trigger found?=w42)
  $BER <- w41
  $"actual IQ rate_2" <- w23
  $"trigger found?" <- w42
  $"actual carrier frequency_2" <- w24
  # no. samples
  $"actual gain (dB)_2" <- w25
  # samples/symbol
  Divide(x=w23, y=$"symbol rate (sym/s)_2")
