vi "Error Cluster From Error Code_2.gvi"   [LabVIEW NXG]
inputs:
  "error code (0)": i32, required
  "error message (\"\")": string
  "error in (no error)": error
  "show call chain? (False)": bool
  "is warning? (False)": bool
outputs:
  "Error Out": error
panel controls:
  "call chain header": string = "\n<b>Complete call chain:</b>"
diagram:
  sequence {
    frame 0 {
      case ($"error code (0)") {
        frame 0 {
          w1 = $"error in (no error)"
        }
        frame 1, Default {
          case ($"error in (no error)") {
            frame No Error {
              Property Node(instance in=$"error in (no error)") -> ("code"=w2)
              Is Not Equal To 0(x=w2) -> w3
              Logical And($"is warning? (False)", w3) -> w4
              case (w4) {
                frame False, Default {
                  Call Chain() -> (callchain=w5)
                  Array Index(array=w5) -> (out0[1]=w6)
                  Is Empty String Or Path(string/path=$"error message (\"\")") -> w7
                  case ($"show call chain? (False)") {
                    frame False, Default {
                      w8 = ""
                    }
                    frame True {
                      Delete From Array(inArray=w5, index0=0) -> w9
                      Select(s=w7, t="<APPEND>\n", f="") -> w10
                      Concatenate Strings(w10, $"call chain header") -> w11
                      s1 = w11  # shift register
                      for {
                        w12 = each element of w9
                        Concatenate Strings(s1, "\r\n", "     ", w12) -> w13
                        next s1 = w13
                      }
                      w8 = s1
                    }
                  }
                  Format Into String(formatString="<ERR>\\n%s\\n\\n%s", $"error message (\"\")", w8) -> w14
                  Match Pattern(regular expression="[\\t\\n\\r\\s]*$", string=w14) -> (before substring=w15)
                  Select(s=w7, t=w8, f=w15) -> w16
                  Concatenate Strings(w6, w16) -> w17
                  Not(x=$"is warning? (False)") -> w18
                  Property Node(instance in=no error, "status"=w18, "code"=$"error code (0)", "source"=w17) -> (instance out=w1)
                }
                frame True {
                  w1 = $"error in (no error)"
                }
              }
            }
            frame Error {
              w1 = $"error in (no error)"
            }
          }
        }
      }
    }
  }
  $"Error Out" <- w1
