vi "FrameSync(Complex).gvi"   [LabVIEW NXG]
inputs:
  "Input Signal": cluster{"t0": f64, "dt": f64, "Y": c128[]}
  "Sampled Input": c128[]
  "Receiver Sampling Factor": f64 = 20
  "error in (no error)": error
outputs:
  "Output Signal": cluster{"t0": f64, "dt": f64, "Y": c128[]}
  "Aligned Samples": c128[]
  "max index": i32
  "error out": error
panel indicators:
  "Cross Correlation": f64[]
diagram:
  case ($"error in (no error)") {
    frame No Error {
      Property Node(instance in=$"Input Signal") -> ("dt"=w4, "Y"=w5)
      Array Size(array=$"Sampled Input") -> (size(s)=w6)
      Absolute Value(x=$"Sampled Input") -> w7
      Square(x=w7) -> w8
      Add Array Elements(numeric array=w8) -> (sum=w9)
      Divide(x=w9, y=w6) -> w10
      Square Root(x=w10) -> w11
      Divide(x=$"Sampled Input", y=w11) -> w12
      Complex Conjugate(x + iy=w12) -> w13
      w14 = [0.707+0.707i, 0.707+0.707i, 0.707+0.707i, 0.707+0.707i, 0.707+0.707i, -0.707-0.707i, -0.707-0.707i, 0.707+0.707i, 0.707+0.707i, -0.707-0.707i, 0.707+0.707i, -0.707-0.707i, 0.707+0.707i]
      Build Array[ConcatenateInputs=True](w14, w14) -> w15
      call "1D Cross Correlation (CDB).gvi"(x=w15, y=w13) -> (rxy=w16, error=w17)
      Absolute Value(x=w16) -> w18
      call "Threshold Detector.gvi"(x=w18, threshold=20) -> (indices=w19)
      Array Index(array=w19) -> (out0[0]=w20)
      Increment(x=w20) -> w21
      Subtract(x=w21, y=26) -> w22
      Multiply($"Receiver Sampling Factor", w22) -> w23
      Array Subset(array=w5, index0=w23) -> w24
      w25 = cluster{"t0": f64, "dt": f64, "Y": c128[]} {all zero or empty}
      Property Node(instance in=w25, "dt"=w4, "Y"=w24) -> (instance out=w3)
      Array Subset(array=$"Sampled Input", index0=w21) -> w1
      $"Cross Correlation" <- w18
      $"max index" <- w20
      call "Error Cluster From Error Code.gvi"(error code (0)=w17, error message ("")="Sliding Correlator: crosscorrelation", error in (no error)=$"error in (no error)") -> (Error Out=w2)
    }
    frame Error {
      w26 = cluster{"t0": f64, "dt": f64, "Y": c128[]} {"t0"=0, "dt"=1, "Y"=[]}
      w1 = f64[] []
      w2 = $"error in (no error)"
      w3 = w26
    }
  }
  $"Output Signal" <- w3
  $"Aligned Samples" <- w1
  $"error out" <- w2
