vi "FrameSync.gvi"   [LabVIEW NXG]
inputs:
  "Input Signal": cluster{"t0": f64, "dt": f64, "Y": f64[]}
  "Receiver Sampling Factor": f64 = 20
  "Sampled Input": f64[]
  "error in (no error)": error
outputs:
  "error out": error
  "Aligned Samples": f64[]
  "Output Signal": cluster{"t0": f64, "dt": f64, "Y": f64[]}
panel indicators:
  "Cross Correlation": f64[]
  "max index": i32
diagram:
  case ($"error in (no error)") {
    frame No Error {
      Property Node(instance in=$"Input Signal") -> ("dt"=w4, "Y"=w5)
      call "Normalize Vector.gvi"(Vector=$"Sampled Input") -> (Normalized Vector=w6, error=w7)
      Build Array[ConcatenateInputs=True]([1, 1, 1, 1, 1, -1, -1, 1, 1, -1, 1, -1, 1], [1, 1, 1, 1, 1, -1, -1, 1, 1, -1, 1, -1, 1]) -> w8
      call "1D Cross Correlation (DBL).gvi"(x=w8, y=w6) -> (rxy=w9, error=w10)
      Absolute Value(x=w9) -> w11
      call "Threshold Detector.gvi"(x=w11, threshold=20) -> (indices=w12)
      Array Index(array=w12) -> (out0[0]=w13)
      Increment(x=w13) -> w14
      Subtract(x=w14, y=26) -> w15
      Multiply($"Receiver Sampling Factor", w15) -> w16
      Array Subset(array=w5, index0=w16) -> w17
      w18 = cluster{"t0": f64, "dt": f64, "Y": f64[]} {all zero or empty}
      Property Node(instance in=w18, "dt"=w4, "Y"=w17) -> (instance out=w3)
      $"Cross Correlation" <- w11
      Array Index(array=w9) -> (out0[w13]=w19)
      Is Greater(x=w19, y=-20) -> w20
      Array Subset(array=$"Sampled Input", index0=w14) -> w21
      case (w20) {
        frame False, Default {
          Negate(x=w21) -> w1
        }
        frame True {
          w1 = w21
        }
      }
      $"max index" <- w13
      call "Error Cluster From Error Code.gvi"(error code (0)=w7, error message ("")="Normalize", error in (no error)=$"error in (no error)") -> (Error Out=w22)
      call "Error Cluster From Error Code.gvi"(error code (0)=w10, error message ("")="Sliding Correlator: crosscorrelation", error in (no error)=w22) -> (Error Out=w2)
    }
    frame Error {
      w23 = cluster{"t0": f64, "dt": f64, "Y": f64[]} {all zero or empty}
      w1 = f64[] []
      w2 = $"error in (no error)"
      w3 = w23
    }
  }
  $"Output Signal" <- w3
  $"Aligned Samples" <- w1
  $"error out" <- w2
