vi "PhaseSync.gvi"   [LabVIEW NXG]
inputs:
  "In": c128[]
outputs:
  "Out": f64[]
diagram:
  Square(x=$In) -> w1
  Complex To Polar(r * e^(i*theta)=w1) -> (theta=w2)
  call "Median Filter2.gvi"(X=w2) -> (Filtered X=w3)
  call "Unwrap Phase.gvi"(phase=w3) -> (unwrapped phase=w4)
  Divide(x=w4, y=2) -> w5
  Polar To Complex(r=1, theta=w5) -> (r * e^(i*theta)=w6)
  Complex Conjugate(x + iy=w6) -> w7
  Multiply($In, w7) -> w8
  Complex To Real Imaginary(x + iy=w8) -> (x=w9)
  $Out <- w9
