vi "PulseAlign(real).gvi"   [LabVIEW NXG]
inputs:
  "Input Signal": waveform<f64> = {dt=1, Y=[]}
  "Receiver Sampling Factor": i32 = 100
  "error in (no error)": error
outputs:
  "aligned signal": waveform<f64>
  "alignment offset (samples)": i32
  "error out": error
panel indicators:
  "Objective Function": f64[]
diagram:
  Property Node(instance in=$"Input Signal") -> ("Y"=w1)
  call "Mean (DBL).gvi"(X=w1) -> (mean=w2)
  Subtract(x=w1, y=w2) -> w3
  # Select the index corresponding to the highest value
  # in the array. This is the index in which the input
  # signal is nonzeo
  for (N = $"Receiver Sampling Factor") (iteration -> i1) {
    Array Subset(array=w3, index0=i1) -> w5
    call "Decimate (single shot, DBL).gvi"(x=w5, decimating factor=$"Receiver Sampling Factor") -> (decimated array=w6)
    # For every index of the array, it
    # computes the square of the received
    # input. This is nonzero only at the
    # index corresponding to the transmitted symbol
    Square(x=w6) -> w7
    Add Array Elements(numeric array=w7) -> (sum=w8)
    append w8 to w4
  }
  Array Max And Min(array=w4) -> (max index(es)=w9)
  # Shift the signal by this index
  Array Subset(array=w1, index0=w9) -> w10
  Property Node(instance in=$"Input Signal", "Y"=w10) -> (instance out=w11)
  $"aligned signal" <- w11
  $"Objective Function" <- w4
  $"alignment offset (samples)" <- w9
  $"error out" <- $"error in (no error)"
